% Simulink data dictionary DoorLockCntr_data.sldd

AirBagOn = Simulink.Signal(StorageClass="ExportedGlobal", DataType="boolean")
DLock = Simulink.Signal(StorageClass="ExportedGlobal", DataType="Enum: LockStatus", Dimensions=[1 2])
DLockCheck = Simulink.Signal(StorageClass="ExportedGlobal", DataType="boolean")
DLockCmd = Simulink.Signal(StorageClass="ExportedGlobal", DataType="boolean")
DLockCmd_prev = Simulink.Signal(StorageClass="FileScope", DataType="boolean")
DLockDiag = Simulink.Signal(StorageClass="ExportedGlobal", DataType="boolean")
DiagCnt = Simulink.Signal(StorageClass="FileScope", DataType="uint8")
DiagCntVal = Simulink.Parameter(20, StorageClass="ExportedGlobal", DataType="uint8")
EngStart = Simulink.Signal(StorageClass="ExportedGlobal", DataType="boolean")
LeftDPos = Simulink.Signal(StorageClass="ExportedGlobal", DataType="single")
RightDPos = Simulink.Signal(StorageClass="ExportedGlobal", DataType="single")
Speed = Simulink.Signal(StorageClass="ExportedGlobal", DataType="single", Min=0, Max=255)
SpeedCnt = Simulink.Signal(StorageClass="FileScope", DataType="uint8")
SpeedCntVal = Simulink.Parameter(20, StorageClass="ExportedGlobal", DataType="uint8")
SpeedTh = Simulink.Parameter(5, StorageClass="ExportedGlobal", DataType="single")

LockStatus = enum(DataScope="Exported", HeaderFile="DoorLockCntr_types.h", DefaultValue="NEUTRAL")
  NEUTRAL = 0
  UNLOCK = 1
  LOCK = 2