test file "Test_DoorLockCntr"
  coverage: Decision, MCDC, Condition

suite "UnitTest_DoorLockCntr"

  case "DoorLockCommand_Testcase1" [baseline]
    model DoorLockCntr, harness DLockCommand_Harness (for DoorLockCntr/DoorLockCommand)
    input "testcase" from tc_DLockCmd.xlsx, mapped to Speed, EngStart, AirBagOn (active)
    baseline "testcase"
      DLockCmd

  case "DoorLockCheck_TestCase1" [baseline]
    model DoorLockCntr, harness DLockCheck_Harness (for DoorLockCntr/DoorLockCheck)
    input "testcase1" from tc_DLockCheck.xlsx, mapped to DLockCmd, DLock (active)
    input "testcase2" from tc_DLockCheck.xlsx, mapped to DLockCmd, DLock
    baseline "testcase1"
      DLockCheck
    baseline "testcase2"
      DLockCheck
    iterations:
      Iteration1: ExternalInput "testcase1", Baseline "testcase1"
      Iteration2: ExternalInput "testcase2", Baseline "testcase2"

  case "DoorLockDiag_TestCase1" [baseline]
    model DoorLockCntr, harness DLockDiag_Harness (for DoorLockCntr/DoorLockDiag)
    input "testcase" from tc_DLockDiag.xlsx, mapped to DLockCmd, DLockCheck (active)
    baseline "testcase"
      DLockDiag

  case "DoorLockStatus_Testcase1" [baseline]
    model DoorLockCntr, harness DLockStatus_Harness (for DoorLockCntr/DoorLockStatus)
    input "testcase" from tc_DLockStatus.xlsx, mapped to LeftDPos, RightDPos (active)
    baseline "testcase"
      DLock

suite "TestForAggregation"

  case "Test_DoorLockCntr" [simulation]
    model DoorLockCntr, stop time 0